# Requirement set untitled (R2022a)

## 1 [#3] (Informational)
Sensor type: INA219

## 2 [#4]
Driver type: TB6612Fng
Vmax=12v
Imax=1.2A
Include Stanby Mode

## 3 [#5]
DC with Hall Encoder
Vmax = 12V
Gear Ration =
PPR =

## 4 [#6]
MEGA PRO 2560
Interrupt pin
PWM pin

## 5 [#7]
Hall Encoder
Quadrature

## 6 [#8]
Estimated all parameters using UKF with Recursive Least Square

## 7 [#9]
Torque control using Cascade from of torque inner and speed outer loop

## 8 [#10]
EKF with Recursive Least square